# Grasshopper definition 10_Rev_Off Axis_Walls.gh (Grasshopper 1.0.8)
# plug-ins: Pufferfish, Rhino.Inside for Autodesk Revit

doubleclick = BooleanToggle(False)
dss_annotation_panel = Panel("Help on WhiteWork")
# Segment
# group modules into larger coherent parts
# User Interface: I/O
dss_log_v5_2 = PythonScript(Help=doubleclick)  # inputs Help: Boolean
# ---------- dss_log_v5_2: Python ----------
"""
Set grasshopper template and provide easy acces to Help file in intranet

"""

"""
Credits:
    20211117
    Created by Vladimir Ondejcik
    White arkitekter AB

Based on:
    WOMBAT version <0.0.1>
    Script by <Brian Ringley>
        def libraries() by <Giulio Piacentino> see <http://www.grasshopper3d.com/forum/topics/gh-filename-is-python>
        def writeToFile() by <Data Analytics Society> see <https://www.youtube.com/watch?v=-TF3mXhnCDw>
    Script version <15 September 2015> 
    Copyright <Creative Commons Sharealike>
"""


#add dsearch default path located on cad.local
import sys
new_path = r"\\sesthfs02\DSEARCH\REPOSITORY\Grasshopper\Xtras\DsearchCode"
if new_path not in sys.path: sys.path.append(new_path)

#import dsearch plugin
import dsearch as ds

import os

print sys.path

#reload module (this has use when working on module)
#reload(ds.DS_Log)
#reload(ds.DS_Links)

#setup template
template=ds.DS_Links.Template
ds.DS_Log.DS_Template(template)

#run help from module 
if Help:
    helpLink=ds.DS_Links.HelpLink
    ds.DS_Log.DS_Help(helpLink)

    #turn toggle back to false
    obj=ghenv.Component.Params.Input[0].Sources[0]
    obj.Value=False
    obj.ExpireSolution(True)
# ---------- end dss_log_v5_2 ----------

dss_projectnumber = Panel("0000")
dss_projectname = Panel("name")

# ----
# Organization of Grasshopper scripts at White:
# Script should be created and annotated always with notion that other person will need to use/edit them.
# Build your script in modules and segments, use color coding and annotation according this template.
# This standard should be applied to all scripts, big or small.
# 
# Read  guide on white work:
# "https://work.white.se/grasshopper-developer-guide/"
# For Advanced users:
# For design scripts running more than a month use "dsInitialize" and "dsScriptLog" functions on Dsearch tab to log changes over time.
dss_annotation_panel_2 = Panel("""Tip of a day:
You can change default colour grups by right clicking
Graphical templates are located on "Dsearch" tab""")
# GRAPHIC
# STANDARD
# In
# data and geometry import from rhino or external platforms
image = ImageSampler(dss_annotation_panel_2, Filter="Colour", Interpolate=False, Umax=1, Umin=0, Vmax=1, Vmin=0, Wrap=0)

query_grids = QueryGrids()

# ---- group: Active view
active_view = ActiveView()

# ---- group: Query Walls
query_categories = QueryCategories(Type=1, Name="Walls", IsVisibleUI=True, IsSubcategory=False)
visible_in_view_filter = VisibleInViewFilter(View=active_view, Inverted=False)
query_view_elements = QueryViewElements(View=active_view, Categories=query_categories, Filter=visible_in_view_filter)

# ---- group: Create filled region type
query_categories_2 = QueryCategories(Type=1, Name="Detail Items", IsVisibleUI=True, IsSubcategory=False)
query_types = QueryTypes(Kind=3, Category=query_categories_2)
match_text = MatchText(Text=query_types, RegEx="Solid", Case=True)
cull_pattern = CullPattern(List=query_types, CullPattern=match_text)
list_length = ListLength(List=cull_pattern)
list_item = ListItem(List=query_types, Index=Slider(2, range=0..10), Wrap=True)
list_item_2 = ListItem(List=cull_pattern, Index=0, Wrap=True)
boolean = Boolean(list_length)
stream_filter = StreamFilter(Gate=boolean, Stream0=list_item, Stream1=list_item_2)
panel = Panel("Filled Region_RiR")

# ----
# Control
# General
# Monitor
# Out
# variable parameters and script execution
# (sliders, boolean togggle, text input,...)
# monitor data and geometry preview (used for panels for example)
# output data to rhino or external platforms
# WIP
# Annotation
# Plugin
# general annotation and notes
# textbased scripting and special plugins
# f.ex: HumanUI, kangaroo,...
# problematic or under repair or construction
# Back-end
# Rotates curve according to closest near pararell gridline - moves hosted elements a little....
dss_annotation_panel_3 = Panel("general development modules")

active_selection = GraphicalElement(query_view_elements)
line = Line(active_selection)
null_item = NullItem(Item=line)  # -> NullFlags, InvalidFlags, Description
line_2 = Line(query_grids)
cull_pattern_2 = CullPattern(List=active_selection, CullPattern=invert(null_item.NullFlags))
graphical_element = GraphicalElement(simplify(graft(cull_pattern_2)))

# ---- group: Create filled region type
panel_2 = Panel("Filled Region_RiR_2")
duplicate_type = DuplicateType(TypeName=panel, Type=stream_filter, FailureProcessingMode=1, TrackingMode=2)

# ----
vector = Vector(unitize(line_2))
vector_2 = Vector(vector)
line_3 = Line(graphical_element)
vector_3 = Vector(unitize(vector_2))
vector_4 = Vector(unitize(line_3))
negative = Negative(Value=vector_3)
create_set = CreateSet(List=flatten([negative, vector_3]))  # -> Set, Map
set_difference = SetDifference(SetA=simplify(graft(vector_4)), SetB=graft(create_set.Set))  # -> simplify(Union)
list_length_2 = ListLength(List=set_difference)
boolean_2 = Boolean(list_length_2)
cull_pattern_3 = CullPattern(List=graphical_element, CullPattern=boolean_2)

# ---- group: Create filled region type
query_fill_patterns = QueryFillPatterns(Type=0)
match_text_2 = MatchText(Text=query_fill_patterns, RegEx="Solid", Case=True)
cull_pattern_4 = CullPattern(List=query_fill_patterns, CullPattern=match_text_2)
query_element_parameters = QueryElementParameters(Element=duplicate_type, Name="Foreground Fill Pattern")
list_item_3 = ListItem(List=cull_pattern_4, Index=0, Wrap=True)
element_parameter = ElementParameter(Element=duplicate_type, Parameter=query_element_parameters, Value=list_item_3)  # -> Element, Value

# ----
create_set_2 = CreateSet(List=flatten(vector_4))  # -> Set, Map

# ---- group: Create filled region type
query_element_parameters_2 = QueryElementParameters(Element=duplicate_type, Name="Foreground Pattern Color")
colour = Colour(ColourSwatch(SwatchColor=RGB(255, 0, 0)))
element_parameter_2 = ElementParameter(Element=duplicate_type, Parameter=query_element_parameters_2, Value=colour)  # -> Element, Value

# ----
vector_5 = Vector(unitize(create_set.Set))
multiplication = Multiplication(A=create_set.Set, B="-1")
create_set_3 = CreateSet(List=[vector_5, multiplication])  # -> Set, Map

clean_tree = CleanTree(RemoveNulls=True, RemoveInvalid=True, RemoveEmpty=True, Tree=cull_pattern_3)
line_4 = Line(clean_tree)
vector_6 = Vector(line_4)
dot_product = DotProduct(VectorA=unitize(vector_6), VectorB=unitize(flatten(create_set_3.Set)), Unitize=False)
integer = Integer(Slider(1, range=0..1))
equality = Equality(FirstNumber=dot_product, SecondNumber=integer)  # -> Equality, Inequality
cull_pattern_5 = CullPattern(List=create_set_3.Set, CullPattern=equality.Equality)
list_length_3 = ListLength(List=cull_pattern_5)  # -> simplify(Length)
cull_pattern_6 = CullPattern(List=clean_tree, CullPattern=invert(list_length_3))
vector_7 = Vector(unitize(create_set_3.Set))
clean_tree_2 = CleanTree(RemoveNulls=True, RemoveInvalid=True, RemoveEmpty=True, Tree=cull_pattern_6)
line_5 = Line(clean_tree_2)
vector_8 = Vector(unitize(line_5))
dot_product_2 = DotProduct(VectorA=vector_8, VectorB=vector_7, Unitize=False)
degrees = Degrees(Radians=dot_product_2)
absolute = Absolute(Value=degrees)
sort_list = SortList(Keys=absolute)  # -> Keys, ValuesA
list_item_4 = ListItem(List=sort_list.Keys, Index=0, Wrap=True)
smaller_than = SmallerThan(FirstNumber=list_item_4, SecondNumber=Slider(1, range=0..1))  # -> SmallerThan, OrEqualTo
cull_pattern_7 = CullPattern(List=clean_tree_2, CullPattern=smaller_than.SmallerThan)
select_element = SelectElement(Element=cull_pattern_7, Selected=Toggle(False))  # -> Element, Selected

# ---- group: Needs to be rotated
clean_tree_3 = CleanTree(RemoveNulls=True, RemoveInvalid=True, RemoveEmpty=True, Tree=cull_pattern_7)
line_6 = Line(clean_tree_3)
unit_z = UnitZ(Factor=1)
vector_9 = Vector(line_6)
cross_product = CrossProduct(VectorA=vector_9, VectorB=unit_z, Unitize=False)  # -> Vector, Length
curve_middle = CurveMiddle(Curve=line_6)
construct_plane = ConstructPlane(Origin=curve_middle, XAxis=unitize(line_6), YAxis=unitize(cross_product.Vector))
bounding_rectangle = BoundingRectangle(Geometry=clean_tree_3, Plane=construct_plane, Axis=0, Slide=0, Union=True)  # -> Bounding, DimensionX, DimensionY
scale_nu = ScaleNU(Geometry=bounding_rectangle.Bounding, Plane=construct_plane, ScaleX=1, ScaleY=Slider(0.6, range=0..1), ScaleZ=1)  # -> Geometry, Transform
add_region = AddRegion(View=active_view, Boundary=simplify(scale_nu.Geometry), Type=element_parameter_2.Element)

# ----
vector_10 = Vector(unitize(flatten(vector_9)))
create_set_4 = CreateSet(List=vector_10)  # -> Set, Map

# ---- group: Needs to be rotated
select_element_2 = SelectElement(Element=clean_tree_3, Selected=Toggle(True))  # -> Element, Selected
